# Dynamo custom node CheckIfClosestWallOrinetationEqualDoorHandOrientation.dyf "IfDoorFaceVectorEqualFirstWallSurfaceVector" (Dynamo 2.3.0.5885)
# category: Revit
# Check if door face orientation unit vector equals to first wall surface unit vector

vector = Input(vector: Autodesk.DesignScript.Geometry.Vector)
X = Vector.X(vector=vector)
code_block = CodeBlock { 3; }
round = Math.Round(number=X, digits=code_block)
vector_2 = Input(vector: Autodesk.DesignScript.Geometry.Vector)
X_2 = Vector.X(vector=vector_2)
round_2 = Math.Round(number=X_2, digits=code_block)
eq = round == round_2
Y = Vector.Y(vector=vector)
round_3 = Math.Round(number=Y, digits=code_block)
Y_2 = Vector.Y(vector=vector_2)
round_4 = Math.Round(number=Y_2, digits=code_block)
eq_2 = round_3 == round_4
and_ = eq && eq_2
var = Output(and_)  # "var[]..[]"
