# Dynamo graph Doorside-Object-Placing-on-Wall-Automation (Rev B).dyn (Dynamo 2.6.2.15705)
# packages: Clockwork for Dynamo 2.x 2.3.0

categories = Categories("OST_Walls")
all_elements_of_category = ElementsOfCategory(Category=categories)
categories_2 = Categories("OST_Doors")
all_elements_of_category_2 = ElementsOfCategory(Category=categories_2)
getHost = FamilyInstance.GetHost(familyInstance=all_elements_of_category_2)
getLocation = Element.GetLocation(element=getHost)
getLocation_2 = Element.GetLocation(element=all_elements_of_category)

# group: Find intersected wall attached with door & wall
intersectAll = Geometry.IntersectAll(geometry=getLocation, others=getLocation_2, lacing=CrossProduct)

isEmpty = List.IsEmpty(list=intersectAll@@L2, lacing=Shortest)
boolean = BoolSelector(false)
allIndicesOf = List.AllIndicesOf(list=isEmpty@L2, item=boolean, lacing=CrossProduct)
getItemAtIndex = List.GetItemAtIndex(list=all_elements_of_category, index=allIndicesOf)
allIndicesOf_2 = List.AllIndicesOf(list=getItemAtIndex, item=getHost, lacing=Longest)
removeItemAtIndex = List.RemoveItemAtIndex(list=getItemAtIndex, indices=allIndicesOf_2, lacing=Longest)

# group: Doors Location
doors_location = Element.GetLocation(element=all_elements_of_category_2)

flatten = List.Flatten(list=intersectAll@@L3)

# group: Closest wall & distance between door and wall
removeItemAtIndex_2 = List.RemoveItemAtIndex(list=flatten, indices=allIndicesOf_2, lacing=Longest)
distanceTo = Geometry.DistanceTo(geometry=doors_location, other=removeItemAtIndex_2, lacing=Shortest)
minimumItem = List.MinimumItem(list=distanceTo, lacing=Shortest)
allIndicesOf_3 = List.AllIndicesOf(list=distanceTo, item=minimumItem, lacing=Longest)
getItemAtIndex_2 = List.GetItemAtIndex(list=removeItemAtIndex, index=allIndicesOf_3, lacing=Longest)
flatten_2 = List.Flatten(list=getItemAtIndex_2)
getItemAtIndex_3 = List.GetItemAtIndex(list=removeItemAtIndex_2, index=allIndicesOf_3, lacing=Longest)
flatten_3 = List.Flatten(list=getItemAtIndex_3)
distanceTo_2 = Geometry.DistanceTo(geometry=doors_location, other=flatten_3)

# group: Second closest wall & distance between door and wall
removeItemAtIndex_3 = List.RemoveItemAtIndex(list=removeItemAtIndex, indices=allIndicesOf_3, lacing=Longest)
removeItemAtIndex_4 = List.RemoveItemAtIndex(list=distanceTo, indices=allIndicesOf_3, lacing=Longest)
minimumItem_2 = List.MinimumItem(list=removeItemAtIndex_4, lacing=Shortest)
allIndicesOf_4 = List.AllIndicesOf(list=removeItemAtIndex_4, item=minimumItem_2, lacing=Longest)
getItemAtIndex_4 = List.GetItemAtIndex(list=removeItemAtIndex_3, index=allIndicesOf_4, lacing=Longest)
flatten_4 = List.Flatten(list=getItemAtIndex_4)
removeItemAtIndex_5 = List.RemoveItemAtIndex(list=removeItemAtIndex_2, indices=allIndicesOf_3, lacing=Longest)
getItemAtIndex_5 = List.GetItemAtIndex(list=removeItemAtIndex_5, index=allIndicesOf_4, lacing=Longest)
flatten_5 = List.Flatten(list=getItemAtIndex_5)
distanceTo_3 = Geometry.DistanceTo(geometry=doors_location, other=flatten_5)

# group: Hand orientation vector of door
handOrientation = Python(IN[0]=all_elements_of_category_2)  # "FamilyInstance.HandOrientation"
# ---------- handOrientation.python (14 lines) ----------
import clr

clr.AddReference('RevitNodes')
import Revit
clr.ImportExtensions(Revit.GeometryConversion)
clr.ImportExtensions(Revit.Elements)

clr.AddReference('RevitAPI')
from Autodesk.Revit.DB import *

#Preparing input from dynamo to revit
elems = UnwrapElement(IN[0])

OUT = [e.HandOrientation.ToVector() for e in elems if isinstance(e, FamilyInstance)]
# ----------------------------------------
watch = Watch(handOrientation)

# group: (Input Required)Minimum horizontal distance required from door normal to security panel
integer_slider = IntegerSlider(700, range=0..1000 step 1)

# group: First checker
byTwoPoints = Vector.ByTwoPoints(start=doors_location, end=getItemAtIndex_3)
scale = Vector.Scale(vector=watch, scale_factor=distanceTo_2)
checkIfClosestWallOrinetationEqualDoorHa = Custom[CheckIfClosestWallOrinetationEqualDoorHandOrientation](vector=byTwoPoints, vector_2=scale, lacing=Longest)  # Check if door face orientation unit vector equals to first wall surface unit vector
if_ = If(test=checkIfClosestWallOrinetationEqualDoorHa, true=distanceTo_3, false=distanceTo_2)
min_distance = if_ >= integer_slider

filterByBoolMask = List.FilterByBoolMask(list=all_elements_of_category_2, mask=min_distance, lacing=Shortest)

# group: Face orientation of door
location = FamilyInstance.Location(familyInstance=filterByBoolMask.in)
ZAxis = Vector.ZAxis()
facingOrientation = FamilyInstance.FacingOrientation(familyInstance=filterByBoolMask.in)
byOriginNormalXAxis = Plane.ByOriginNormalXAxis(origin=location, normal=ZAxis, xAxis=facingOrientation, lacing=Longest)
watch_2 = Watch(facingOrientation)

# group: Location of Wall hosted by door
getLocation_3 = Element.GetLocation(element=getHost)

# group: (Input Required) Family Types of Security Panel
# note: Assumption: door is pushed to open
# note: Created by Kenneth Wong
family_types = FamilyTypes("Security_MasterStation_AiPhone_GT-1A (1):as Specified")

# group: Surfaces of a Wall hosted by door
faces = Element.Faces(element=getHost)

# group: Data filter of first checker
watch_3 = Watch(faces)
filterByBoolMask_2 = List.FilterByBoolMask(list=doors_location, mask=min_distance, lacing=Shortest)
filterByBoolMask_3 = List.FilterByBoolMask(list=watch, mask=min_distance, lacing=Shortest)
filterByBoolMask_4 = List.FilterByBoolMask(list=getItemAtIndex_2, mask=min_distance, lacing=Shortest)

# group: Wall surface for security panel to host on
code_block = CodeBlock { 0; }
# note: Start of First Action
wall_surface_0 = List.GetItemAtIndex(list=watch_3@L2, index=code_block, lacing=Longest)
normal_vector_of_surface_0 = Surface.NormalAtPoint(surface=wall_surface_0, point=filterByBoolMask_2.in)
door_face_vector_wall_surface_0 = Custom[Door face vector = wall surface[0]?](vector=normal_vector_of_surface_0, vector_2=watch_2)  # Check if door face orientation unit vector equals to first wall surface unit vector
code_block_2 = CodeBlock { 1; }
wall_surface_1 = List.GetItemAtIndex(list=watch_3@L2, index=code_block_2)
if_2 = If(test=door_face_vector_wall_surface_0, true=wall_surface_1, false=wall_surface_0)
wallSurfaceToGetHostedByPanel = Watch(if_2)

# group: Point of security panel to host on
reverse = Vector.Reverse(vector=filterByBoolMask_3.in)
scale_2 = Vector.Scale(vector=reverse, scale_factor=integer_slider)
point_add_location_of_panel = Point.Add(point=doors_location, vectorToAdd=scale_2)

# group: First action
code_block_3 = CodeBlock { 0; 0; 0; }
byCoordinates = Vector.ByCoordinates(x=code_block_3.out0, y=code_block_3.out1, z=code_block_3.out2)
# note: End of First Action
byFace = FamilyInstance.ByFace(familyType=family_types, face=wallSurfaceToGetHostedByPanel, location=point_add_location_of_panel, referenceDirection=byCoordinates, lacing=Longest)

# group: Face orientation vector of door
facingOrientation_2 = FamilyInstance.FacingOrientation(familyInstance=all_elements_of_category_2)
watch_4 = Watch(facingOrientation_2)

# group: Second Checker (bent primary wall is within 700mm radius of door normal)
door_face_orientation_vector = Watch(watch_4)
reverse_2 = Vector.Reverse(vector=watch)
primary_wall_orientation_vector = Watch(reverse_2)
add = Vector.Add(vector=door_face_orientation_vector, vectorToAdd=primary_wall_orientation_vector)
location_of_closest_wall = Element.GetLocation(element=getItemAtIndex_2)
door_location = Watch(doors_location)
reverse_3 = Vector.Reverse(vector=door_face_orientation_vector)
scale_3 = Vector.Scale(vector=reverse_3, scale_factor=integer_slider)
add_2 = Point.Add(point=door_location, vectorToAdd=scale_3)
scale_4 = Vector.Scale(vector=primary_wall_orientation_vector, scale_factor=integer_slider)
add_3 = Vector.Add(vector=scale_3, vectorToAdd=scale_4)
code_block_4 = CodeBlock { 1/Math.Sqrt(2); }
scale_5 = Vector.Scale(vector=add_3, scale_factor=code_block_4)
add_4 = Point.Add(point=door_location, vectorToAdd=scale_5)
add_5 = Point.Add(point=door_location, vectorToAdd=scale_4)
byThreePoints = Arc.ByThreePoints(firstPoint=add_2, secondPoint=add_4, thirdPoint=add_5)
doesIntersect = Geometry.DoesIntersect(geometry=location_of_closest_wall, other=byThreePoints)

reverse_4 = Vector.Reverse(vector=watch)
watch_5 = Watch(filterByBoolMask_4.out)

# group: Data filter of second checker
reversed_door_hand_orientation = List.FilterByBoolMask(list=reverse_4@@L1, mask=doesIntersect@L2)  # "Reversed Door Hand Orientation Vector Filter"
closest_intersecting_wall_filter = List.FilterByBoolMask(list=watch_5, mask=doesIntersect)
door_location_filter = List.FilterByBoolMask(list=doors_location, mask=doesIntersect@@L2)

# group: Second action
watch_6 = Watch(reversed_door_hand_orientation.in)
# note: Start of Second Action
faces_2 = Element.Faces(element=closest_intersecting_wall_filter.in)
code_block_5 = CodeBlock { 0; }
getItemAtIndex_6 = List.GetItemAtIndex(list=faces_2@@L2, index=code_block_5, lacing=Longest)
normalAtPoint = Surface.NormalAtPoint(surface=getItemAtIndex_6@@L1, point=door_location_filter.in@L1, lacing=Shortest)
ifDoorFaceVectorEqualFirstWallSurfaceVec = Custom[IfDoorFaceVectorEqualFirstWallSurfaceVector](vector=watch_6@@L1, vector_2=normalAtPoint@L1, lacing=Shortest)  # Check if door face orientation unit vector equals to first wall surface unit vector
code_block_6 = CodeBlock { 1; }
getItemAtIndex_7 = List.GetItemAtIndex(list=faces_2@@L2, index=code_block_6, lacing=Longest)
flatten_6 = List.Flatten(list=getItemAtIndex_7)
flatten_7 = List.Flatten(list=getItemAtIndex_6)
empty = List.Empty()
intersection_point_of_700mm = Geometry.Intersect(geometry=location_of_closest_wall, other=byThreePoints)  # "Intersection Point of 700mm radius and bent primary wall"
code_block_7 = CodeBlock { 0; 0; 0; }
byCoordinates_2 = Vector.ByCoordinates(y=code_block_7.out1, z=code_block_7.out2)

if_3 = If(test=ifDoorFaceVectorEqualFirstWallSurfaceVec, true=flatten_6, false=flatten_7)

# group (continued): Second action
replaceNull = Custom[List.ReplaceNull](seq=if_3, replacement=empty)  # package Clockwork for Dynamo 2.x; Replaces all null values within a given list with a substitute
# note: End of Second Action
byFace_2 = FamilyInstance.ByFace(familyType=family_types, face=replaceNull, location=intersection_point_of_700mm, referenceDirection=byCoordinates_2, lacing=Longest)

# group: Third checker (bent primary wall is within 700mm radius of door normal)
door_face_orientation_vector_2 = Watch(watch_4)
secondary_wall_orientation = Watch(watch)  # "Secondary wall orientation vector"
add_6 = Vector.Add(vector=door_face_orientation_vector_2, vectorToAdd=secondary_wall_orientation)
location_of_closest_wall_2 = Element.GetLocation(element=getItemAtIndex_2)
door_location_2 = Watch(doors_location)
reverse_5 = Vector.Reverse(vector=door_face_orientation_vector_2)
scale_6 = Vector.Scale(vector=reverse_5, scale_factor=integer_slider)
add_7 = Point.Add(point=door_location_2, vectorToAdd=scale_6)
scale_7 = Vector.Scale(vector=secondary_wall_orientation, scale_factor=integer_slider)
add_8 = Vector.Add(vector=scale_6, vectorToAdd=scale_7)
code_block_8 = CodeBlock { 1/Math.Sqrt(2); }
scale_8 = Vector.Scale(vector=add_8, scale_factor=code_block_8)
add_9 = Point.Add(point=door_location_2, vectorToAdd=scale_8)
add_10 = Point.Add(point=door_location_2, vectorToAdd=scale_7)
byThreePoints_2 = Arc.ByThreePoints(firstPoint=add_7, secondPoint=add_9, thirdPoint=add_10)
doesIntersect_2 = Geometry.DoesIntersect(geometry=location_of_closest_wall_2, other=byThreePoints_2)

reverse_6 = Vector.Reverse(vector=watch)
watch_7 = Watch(closest_intersecting_wall_filter.out)

# group: Data filter of third checker
reversed_door_hand_orientation_2 = List.FilterByBoolMask(list=reverse_6@@L1, mask=doesIntersect_2@L2)  # "Reversed Door Hand Orientation Vector Filter"
closest_intersecting_wall_filter_2 = List.FilterByBoolMask(list=watch_7, mask=doesIntersect_2)
door_location_filter_2 = List.FilterByBoolMask(list=doors_location, mask=doesIntersect_2@@L2)

# group: Third action
watch_8 = Watch(reversed_door_hand_orientation_2.in)
# note: Start of Third Action
faces_3 = Element.Faces(element=closest_intersecting_wall_filter_2.in)
code_block_9 = CodeBlock { 0; }
getItemAtIndex_8 = List.GetItemAtIndex(list=faces_3@@L2, index=code_block_9, lacing=Longest)
normalAtPoint_2 = Surface.NormalAtPoint(surface=getItemAtIndex_8@@L1, point=door_location_filter_2.in@L1, lacing=Shortest)
ifDoorFaceVectorEqualFirstWallSurfaceVec_2 = Custom[IfDoorFaceVectorEqualFirstWallSurfaceVector](vector=watch_8@@L1, vector_2=normalAtPoint_2@L1, lacing=Shortest)
flatten_8 = List.Flatten(list=getItemAtIndex_8)
code_block_10 = CodeBlock { 1; }
getItemAtIndex_9 = List.GetItemAtIndex(list=faces_3@@L2, index=code_block_10, lacing=Longest)
flatten_9 = List.Flatten(list=getItemAtIndex_9)
if_4 = If(test=ifDoorFaceVectorEqualFirstWallSurfaceVec_2, true=flatten_8, false=flatten_9)
empty_2 = List.Empty()
# note: End of Third Action
replaceNull_2 = Custom[List.ReplaceNull](seq=if_4, replacement=empty_2)
intersection_point_of_700mm_2 = Geometry.Intersect(geometry=location_of_closest_wall_2, other=byThreePoints_2)  # "Intersection Point of 700mm radius and bent primary wall"
code_block_11 = CodeBlock { 0; 0; 0; }
byCoordinates_3 = Vector.ByCoordinates(x=code_block_11.out0, y=code_block_11.out1, z=code_block_11.out2)
byFace_3 = FamilyInstance.ByFace(familyType=family_types, face=replaceNull_2, location=intersection_point_of_700mm_2, referenceDirection=byCoordinates_3, lacing=Longest)

watch_9 = Watch(closest_intersecting_wall_filter_2.out)
watch_10 = Watch(getItemAtIndex_3)
flatten_10 = List.Flatten(list=watch_10)
isNotEmpty = Custom[List.IsNotEmpty](seq=watch_9, lacing=Longest)  # package Clockwork for Dynamo 2.x; Just the inversion of the built-in Is Empty List node.

# group: Last data filter
filterByBoolMask_5 = List.FilterByBoolMask(list=flatten_10, mask=isNotEmpty, lacing=Shortest)
filterByBoolMask_6 = List.FilterByBoolMask(list=getLocation, mask=isNotEmpty, lacing=Shortest)

# group: Last action
faces_4 = Element.Faces(element=watch_9)
code_block_12 = CodeBlock { 1; }
getItemAtIndex_10 = List.GetItemAtIndex(list=faces_4@@L2, index=code_block_12)
empty_3 = List.Empty()
replaceNull_3 = Custom[List.ReplaceNull](seq=getItemAtIndex_10, replacement=empty_3)
# note: Start of Fourth Action
closest_intersecting_point_of = Watch(filterByBoolMask_5.in)  # "Closest intersecting point of bent wall"
wall_line = Watch(filterByBoolMask_6.in)
startPoint = Curve.StartPoint(curve=wall_line)
eq = startPoint == closest_intersecting_point_of
endPoint = Curve.EndPoint(curve=wall_line)
if_5 = If(test=eq, true=startPoint, false=endPoint)
byTwoPoints_2 = Vector.ByTwoPoints(start=closest_intersecting_point_of, end=if_5)
wall_line_direction = Line.Direction(line=wall_line)
wall_line_length = Vector.Length(vector=wall_line_direction)
code_block_13 = CodeBlock(length=wall_line_length) { 700/length; }
scale_9 = Vector.Scale(vector=byTwoPoints_2, scale_factor=code_block_13)
add_11 = Point.Add(point=closest_intersecting_point_of, vectorToAdd=scale_9)
code_block_14 = CodeBlock { 0; 0; 0; }
byCoordinates_4 = Vector.ByCoordinates(x=code_block_14.out0, y=code_block_14.out1, z=code_block_14.out2)
# note: End of Fourth Action
byFace_4 = FamilyInstance.ByFace(familyType=family_types, face=replaceNull_3, location=add_11, referenceDirection=byCoordinates_4, lacing=Longest)

code_block_15 = CodeBlock {  }
comments = CodeBlock()
# ---------- comments.designscript (6 lines) ----------
/*
Only use in 1st, 2nd & 3rd actions
Assume door knob is the preferable side to put security panel
Hand orientation vector = vector from door to door knob
Use this vector to find the location of security panel
*/;
# ----------------------------------------
comments_2 = CodeBlock()
# ---------- comments_2.designscript (3 lines) ----------
/*

*/;
# ----------------------------------------
comments_3 = CodeBlock()
# ---------- comments_3.designscript (7 lines) ----------
/*
Only use in 1st and 2nd actions
Assume all walls are push to open from outside
Vector perpendicular from door / wall face
Use this vector to find the right orientation of wall to place
secuity panel
*/;
# ----------------------------------------
comments_4 = CodeBlock()
# ---------- comments_4.designscript (6 lines) ----------
/*
Find the list of intersection line or
point of
(1) Wall attached with Door
(2) All walls
*/;
# ----------------------------------------
comments_5 = CodeBlock()
# ---------- comments_5.designscript (3 lines) ----------
/*
Remove all empty items in list
*/;
# ----------------------------------------
comments_6 = CodeBlock()
# ---------- comments_6.designscript (4 lines) ----------
/*
Convert vectors to whole number and check whether
they are identical
*/;
# ----------------------------------------
comments_7 = CodeBlock()
# ---------- comments_7.designscript (4 lines) ----------
/*
Filter out the surfaces that
do not satisfy this case 1
*/;
# ----------------------------------------
comments_8 = CodeBlock()
# ---------- comments_8.designscript (6 lines) ----------
/*
Form an arc from door centre to
point 700mm away from door centre
along the wall at the door knob
side
*/;
# ----------------------------------------
comments_9 = CodeBlock()
# ---------- comments_9.designscript (4 lines) ----------
/*
Find location of security panel
at door knob side
*/;
# ----------------------------------------
comments_10 = CodeBlock()
# ---------- comments_10.designscript (4 lines) ----------
/*
Find location of security panel
at non-door knob side
*/;
# ----------------------------------------
comments_11 = CodeBlock()
# ---------- comments_11.designscript (5 lines) ----------
/*
If all walls are not intersecting
the arcs, find location of security
panel at door knob side
*/;
# ----------------------------------------
comments_12 = CodeBlock()
# ---------- comments_12.designscript (5 lines) ----------
/*
Receive walls that do
not have security panel
in first action
*/;
# ----------------------------------------
comments_13 = CodeBlock()
# ---------- comments_13.designscript (5 lines) ----------
/*
Receive walls that do
not have security panel
in first & second action
*/;
# ----------------------------------------
comments_14 = CodeBlock()
# ---------- comments_14.designscript (6 lines) ----------
/*
Receive walls that do
not have security panel
in first, second &
third action
*/;
# ----------------------------------------
